# Grasshopper definition home_background.gh (Grasshopper 1.0.7)
# plug-ins: Urbano

# Step1. Download Map
panel = Panel("-73.8927")
number_slider = Slider(0.5, range=0..1)  # disabled
panel_2 = Panel("""restaurant
restaurant
fast_food
fast_food""")

panel_3 = Panel("""supermarket_store
department_store
supermarket_store
department_store""")
curve = Curve([<curve referenced from the Rhino model> x3])
point = Point([<point referenced from the Rhino model> x4])
merge = Merge(Data1=Slider(36, range=20..40), Data2=Slider(24, range=20..40), Data3=Slider(24, range=20..40))
amenity_capacity = AmenityCapacity(
    Activity=panel_2,
    Area=-1,
    LogisticsAreaProportion=0.2,
    AmenityCapacityData="""post_office, 5, 15
bank, 5, 15
cinema, 1, 248
theatre, 1, 215
arts_centre, 3, 20
department_store, 1, 78
supermarket_store, 2, 32
convenience_store, 1, 39
hardware_store, 1, 50
pharmacy, 1, 42
restaurant, 2, 35
fast_food, 1, 36
cafe, 1, 50
bar, 1, 47
pub, 1, 47
clothes_store, 2, 21
books_store, 1, 26
beauty_store, 1, 27
shoes_store, 1, 38""")
create_metadata = CreateMetadata(KeysInMetadata="amenity", ValuesInMetadata=graft(panel_2))  # -> flatten(Metadata)
create_metadata_2 = CreateMetadata(KeysInMetadata="height", ValuesInMetadata=graft(merge))  # -> flatten(Metadata)
merge_metadata = MergeMetadata(Metadata=create_metadata, Metadata_2=amenity_capacity)
create_amenity = CreateAmenity(PointLocationOfAmenity=point, Metadata=merge_metadata)
arrange_amenities_by_building = ArrangeAmenitiesByBuilding(Amenities=flatten(create_amenity), Buildings=flatten(curve))  # -> AmenitiesByBuilding, Buildings
create_building = CreateBuilding(
    BuildingCurve=graft(curve),
    Metadata=graft(create_metadata_2),
    AmenitiesInBuilding=arrange_amenities_by_building.AmenitiesByBuilding)

curve_2 = Curve([<curve referenced from the Rhino model> x3])
point_2 = Point([<point referenced from the Rhino model> x4])
amenity_capacity_2 = AmenityCapacity(
    Activity=panel_2,
    Area=-1,
    LogisticsAreaProportion=0.2,
    AmenityCapacityData="""post_office, 5, 15
bank, 5, 15
cinema, 1, 248
theatre, 1, 215
arts_centre, 3, 20
department_store, 1, 78
supermarket_store, 2, 32
convenience_store, 1, 39
hardware_store, 1, 50
pharmacy, 1, 42
restaurant, 2, 35
fast_food, 1, 36
cafe, 1, 50
bar, 1, 47
pub, 1, 47
clothes_store, 2, 21
books_store, 1, 26
beauty_store, 1, 27
shoes_store, 1, 38""")
create_metadata_3 = CreateMetadata(KeysInMetadata="amenity", ValuesInMetadata=graft(panel_2))  # -> flatten(Metadata)
merge_2 = Merge(Data1=Slider(20, range=20..40), Data2=Slider(36, range=20..40), Data3=Slider(24, range=20..40))
create_metadata_4 = CreateMetadata(KeysInMetadata="height", ValuesInMetadata=graft(merge_2))  # -> flatten(Metadata)
merge_metadata_2 = MergeMetadata(Metadata=create_metadata_3, Metadata_2=amenity_capacity_2)
create_amenity_2 = CreateAmenity(PointLocationOfAmenity=point_2, Metadata=merge_metadata_2)
arrange_amenities_by_building_2 = ArrangeAmenitiesByBuilding(Amenities=flatten(create_amenity_2), Buildings=flatten(curve_2))  # -> AmenitiesByBuilding, Buildings
create_building_2 = CreateBuilding(
    BuildingCurve=graft(curve_2),
    Metadata=graft(create_metadata_4),
    AmenitiesInBuilding=arrange_amenities_by_building_2.AmenitiesByBuilding)

# ----
# Example3. Adding Amenities Changes Network
# Example1. Construct Efficient Network
# Example4. Adding Amenities Based on Network
curve_3 = Curve(<curve referenced from the Rhino model>)  # disabled
# BE CAUTIOUS ABOUT INTRODUCING BIASED FACTORS.
# OVER-TUNING YOUR MODEL CAN MAKE YOUR ANALYSIS QUESTIONABLE.
# IN THE CURRENT VERSION OF URBANO,
# YOU SHOULD ONLY USE THE BIASED FACTORS WHEN YOU HAVE STRONG EVIDENCE.
# Example2: Evaluate Street/Amenity Utilization (Street Hits/ Amenity Hits)
activity_demand_profile_persona = ActivityDemandProfilePersona(
    ColumnIndex=1,
    Normalize=False,
    Persona="""post_office,0.001237014
bank,0.017194476
cinema,0.038842195
theatre,0.020781812
arts_centre,0.012370127
pharmacy,0.114794771
restaurant,0.196437603
fast_food,0.02350324
cafe,0.082756143
bar,0.101682436
pub,0.101682436
department_store,0.018926293
supermarket_store,0.071004524
convenience_store,0.018184085
hardware_store,0.015338957
clothes_store,0.092528544
books_store,0.010267204
shoes_store,0.025729863
beauty_store,0.036739274""")  # disabled
curve_4 = Curve([<curve referenced from the Rhino model> x571])
panel_4 = Panel("restaurant")  # disabled
curve_5 = Curve([<curve referenced from the Rhino model> x233])  # disabled
curve_6 = Curve([<curve referenced from the Rhino model> x3])
curve_7 = Curve([<curve referenced from the Rhino model> x570])  # disabled
# Example3: Model for Special Case (Biased Routing Factor)
curve_8 = Curve([<curve referenced from the Rhino model> x21])  # disabled
curve_9 = Curve([<curve referenced from the Rhino model> x3])
download_openstreetmap_osm = DownloadOpenStreetMapOSM(LeftBound=panel, RightBound="-73.8804", TopBound="40.7429", BottomBound="40.7338", RunToggle=False)  # -> OSMQueryURL, OSMFilePath
# Step2. Import Map and Build Model
# Example4: Model for Special Case (Biased Destination Factor)
file_path = FilePath(download_openstreetmap_osm.OSMQueryURL)
file_path_2 = FilePath(file_path)
# Step4. Evaluate Design Scenarios
file_path_3 = FilePath(file_path)
# Step5. Generative Approach
file_path_4 = FilePath(file_path_3)  # disabled
point_3 = Point(Point(457.5623716, 375.0459504, 0))  # disabled
import_osm_features = ImportOSMFeatures(OSMPathOrURL=file_path_2, OSMFeatureType="amenity", Format="xml")  # -> flatten(Points), flatten(Metadata), UTMZone, TranslationVector
import_osm_features_2 = ImportOSMFeatures(OSMPathOrURL=file_path_2, OSMFeatureType="street", Format="xml")  # -> Points, Metadata, UTMZone, TranslationVector
vector = Vector(import_osm_features_2.TranslationVector)
# Example2: Evaluate Street Network
text = Text(import_osm_features_2.UTMZone)
import_osm_features_3 = ImportOSMFeatures(OSMPathOrURL=file_path_2, OSMFeatureType="building", Format="xml")  # -> Points, Metadata, UTMZone, TranslationVector
cluster = Cluster_3(osm_path_or_url_2=file_path_4, osm_path_or_url_3=file_path_4, osm_path_or_url=file_path_4, bound=curve_3)  # -> coordinate_2, crv_3, street_network, street_segment_curves; disabled
# Example2. Propose a Pedestrian Boulevard
curve_10 = Curve([<curve referenced from the Rhino model> x380])  # disabled
curve_11 = Curve([<curve referenced from the Rhino model> x4389])  # disabled
# OVERALL, THE GENERATIVE FRAMEWORK IS ADAPTIVE TO DIFFERENT DESIGN GOALS AND CONDITIONS.
# YOU CAN MODIFY THE DECISION MAKING PROCESS AND SIMULATION PARAMETERS ACCORDING TO THE SPECIFIC NEEDS IN PROJECTS.
curve_12 = Curve([<curve referenced from the Rhino model> x380])  # disabled
curve_13 = Curve([<curve referenced from the Rhino model> x4391])  # disabled
amenity_capacity_3 = AmenityCapacity(
    Activity=panel_4,
    Area=-1,
    LogisticsAreaProportion=0.2,
    AmenityCapacityData="""post_office, 5, 15
bank, 5, 15
cinema, 1, 248
theatre, 1, 215
arts_centre, 3, 20
department_store, 1, 78
supermarket_store, 2, 32
convenience_store, 1, 39
hardware_store, 1, 50
pharmacy, 1, 42
restaurant, 2, 35
fast_food, 1, 36
cafe, 1, 50
bar, 1, 47
pub, 1, 47
clothes_store, 2, 21
books_store, 1, 26
beauty_store, 1, 27
shoes_store, 1, 38""")  # disabled
# Example1: Evaluate Program Allocation
import_osm_features_4 = ImportOSMFeatures(OSMPathOrURL=file_path_3, OSMFeatureType="building", Format="xml")  # -> Points, Metadata, UTMZone, TranslationVector
inspect_street_segment = InspectStreetSegment(StreetSegmentCurve=curve_8)  # -> Geometry, Metadata, AdjacentBuildings; disabled
import_osm_features_5 = ImportOSMFeatures(OSMPathOrURL=file_path_3, OSMFeatureType="amenity", Format="xml")  # -> flatten(Points), flatten(Metadata), UTMZone, TranslationVector
import_osm_features_6 = ImportOSMFeatures(OSMPathOrURL=file_path_3, OSMFeatureType="street", Format="xml")  # -> Points, Metadata, UTMZone, TranslationVector
import_osm_features_7 = ImportOSMFeatures(OSMPathOrURL=file_path, OSMFeatureType="building", Format="xml")  # -> Points, Metadata, UTMZone, TranslationVector
import_osm_features_8 = ImportOSMFeatures(OSMPathOrURL=file_path, OSMFeatureType="amenity", Format="xml")  # -> Points, Metadata, UTMZone, TranslationVector
import_osm_features_9 = ImportOSMFeatures(OSMPathOrURL=file_path, OSMFeatureType="street", Format="xml")  # -> Points, Metadata, UTMZone, TranslationVector
create_metadata_5 = CreateMetadata(KeysInMetadata="bike_routing_factor", ValuesInMetadata=number_slider)  # disabled
inspect_street_segment_2 = InspectStreetSegment(StreetSegmentCurve=curve_4)  # -> Geometry, Metadata, AdjacentBuildings
curve_14 = Curve([<curve referenced from the Rhino model> x4])  # disabled
inspect_street_segment_3 = InspectStreetSegment(StreetSegmentCurve=curve_7)  # -> Geometry, Metadata, AdjacentBuildings; disabled
create_metadata_6 = CreateMetadata(KeysInMetadata="amenity", ValuesInMetadata=panel_4)  # disabled
number_slider_2 = Slider(0.8, range=0..1)  # disabled
area = Area(Geometry=curve_5)  # -> Area, Centroid; disabled
arrange_amenities_by_building_3 = ArrangeAmenitiesByBuilding(Amenities=flatten(create_amenity), Buildings=flatten(curve_14))  # -> AmenitiesByBuilding, Buildings; disabled
merge_3 = Merge(Data1=Slider(70, range=20..70), Data2=Slider(33, range=20..40), Data3=Slider(20, range=20..40))
merge_4 = Merge(Data1=Slider(20, range=20..40), Data2=Slider(20, range=20..40), Data3=Slider(20, range=20..40))
number_slider_3 = Slider(0.8, range=0..1)  # disabled
number_slider_4 = Slider(2.3, range=1..10)  # disabled
curve_15 = Curve(cluster.crv_3)  # disabled
merge_metadata_3 = MergeMetadata(Metadata=graft(inspect_street_segment.Metadata), Metadata_2=create_metadata_5)  # disabled
curve_16 = Curve(cluster.street_segment_curves)  # disabled
polyline = PolyLine(Vertices=import_osm_features_3.Points, Closed=False)
create_metadata_7 = CreateMetadata(KeysInMetadata="height", ValuesInMetadata=graft(merge_4))  # -> flatten(Metadata)

create_metadata_8 = CreateMetadata(KeysInMetadata="custom_destination_factor", ValuesInMetadata="1")
create_metadata_9 = CreateMetadata(KeysInMetadata="custom_destination_factor", ValuesInMetadata="10")
number_slider_5 = Slider(7, range=0..7)
list_item = ListItem(List=import_osm_features.Metadata, Index=number_slider_5, Wrap=True)
list_item_2 = ListItem(List=import_osm_features.Points, Index=number_slider_5, Wrap=True)
merge_metadata_4 = MergeMetadata(Metadata=graft(import_osm_features.Metadata), Metadata_2=create_metadata_8)  # -> flatten(Metadata)
merge_metadata_5 = MergeMetadata(Metadata=list_item, Metadata_2=create_metadata_9)
replace_items = ReplaceItems(List=merge_metadata_4, Item=merge_metadata_5, Indices=number_slider_5, Wrap=False)

polyline_2 = PolyLine(Vertices=import_osm_features_2.Points, Closed=False)
create_metadata_10 = CreateMetadata(KeysInMetadata="height", ValuesInMetadata=graft(merge_3))  # -> flatten(Metadata)
curve_17 = Curve(cluster.coordinate_2)  # disabled
polyline_3 = PolyLine(Vertices=import_osm_features_6.Points, Closed=False)
polyline_4 = PolyLine(Vertices=import_osm_features_9.Points, Closed=False)

lookup_metadata = LookupMetadata(MetadataGeometry=import_osm_features_5.Metadata, SearchKey="amenity")
amenity_capacity_4 = AmenityCapacity(
    Activity=lookup_metadata,
    Area=-1,
    LogisticsAreaProportion=0.2,
    AmenityCapacityData="""post_office, 5, 15
bank, 5, 15
cinema, 1, 248
theatre, 1, 215
arts_centre, 3, 20
department_store, 1, 78
supermarket_store, 2, 32
convenience_store, 1, 39
hardware_store, 1, 50
pharmacy, 1, 42
restaurant, 2, 35
fast_food, 1, 36
cafe, 1, 50
bar, 1, 47
pub, 1, 47
clothes_store, 2, 21
books_store, 1, 26
beauty_store, 1, 27
shoes_store, 1, 38""")
merge_metadata_6 = MergeMetadata(Metadata=import_osm_features_5.Metadata, Metadata_2=amenity_capacity_4)

polyline_5 = PolyLine(Vertices=import_osm_features_7.Points, Closed=False)
polyline_6 = PolyLine(Vertices=import_osm_features_4.Points, Closed=False)
merge_metadata_7 = MergeMetadata(Metadata=create_metadata_6, Metadata_2=amenity_capacity_3)  # disabled
create_metadata_11 = CreateMetadata(KeysInMetadata="pedestrian_routing_factor", ValuesInMetadata=number_slider_2)  # disabled
activity_demand_profile_persona_2 = ActivityDemandProfilePersona(
    ColumnIndex=1,
    Normalize=False,
    Persona="""post_office,0.001237014
bank,0.017194476
cinema,0.038842195
theatre,0.020781812
arts_centre,0.012370127
pharmacy,0.114794771
restaurant,0.196437603
fast_food,0.02350324
cafe,0.082756143
bar,0.101682436
pub,0.101682436
department_store,0.018926293
supermarket_store,0.071004524
convenience_store,0.018184085
hardware_store,0.015338957
clothes_store,0.092528544
books_store,0.010267204
shoes_store,0.025729863
beauty_store,0.036739274""")  # disabled
create_amenity_3 = CreateAmenity(PointLocationOfAmenity=graft(area.Centroid), Metadata=merge_metadata_7)  # -> flatten(AmenityPoint); disabled
build_urbano_model = BuildUrbanoModel(Buildings=flatten(curve_15), StreetNetwork=cluster.street_network, BuildToggle=True)  # -> UrbanoModel, BuildingCurves, Activities; disabled
create_metadata_12 = CreateMetadata(KeysInMetadata="pedestrian_routing_factor", ValuesInMetadata=number_slider_3)  # disabled
create_building_3 = CreateBuilding(
    BuildingCurve=arrange_amenities_by_building_3.Buildings,
    AmenitiesInBuilding=arrange_amenities_by_building_3.AmenitiesByBuilding)  # disabled
create_street_network = CreateStreetNetwork(
    StreetCurves=flatten(inspect_street_segment_2.Geometry),
    Metadata=flatten(inspect_street_segment_2.Metadata),
    SplitStreetCurves=True,
    UTMZone=text,
    TranslationVector=vector)  # -> StreetNetwork, StreetSegmentCurves, UTMZone, TranslationVector
create_street_network_2 = CreateStreetNetwork(
    StreetCurves=flatten(polyline_2),
    Metadata=flatten(import_osm_features_2.Metadata),
    SplitStreetCurves=True,
    UTMZone=import_osm_features_2.UTMZone,
    TranslationVector=import_osm_features_2.TranslationVector)  # -> StreetNetwork, StreetSegmentCurves, UTMZone, TranslationVector
create_street_network_3 = CreateStreetNetwork(
    StreetCurves=flatten(polyline_3),
    Metadata=flatten(import_osm_features_6.Metadata),
    SplitStreetCurves=True,
    UTMZone=import_osm_features_6.UTMZone,
    TranslationVector=import_osm_features_6.TranslationVector)  # -> StreetNetwork, StreetSegmentCurves, UTMZone, TranslationVector
create_amenity_4 = CreateAmenity(PointLocationOfAmenity=import_osm_features_8.Points, Metadata=import_osm_features_8.Metadata)
merge_5 = Merge(Data1=flatten(merge_metadata_3), Data2=inspect_street_segment_3.Metadata)  # disabled
merge_6 = Merge(Data1=inspect_street_segment.Geometry, Data2=inspect_street_segment_3.Geometry)  # disabled
create_building_4 = CreateBuilding(BuildingCurve=graft(curve_6), Metadata=graft(create_metadata_10))
arrange_amenities_by_building_4 = ArrangeAmenitiesByBuilding(Amenities=flatten(create_amenity_3), Buildings=flatten(curve_5))  # -> AmenitiesByBuilding, Buildings; disabled
inspect_street_segment_4 = InspectStreetSegment(StreetSegmentCurve=curve_12)  # -> Geometry, Metadata, AdjacentBuildings; disabled
inspect_street_segment_5 = InspectStreetSegment(StreetSegmentCurve=curve_11)  # -> Geometry, Metadata, AdjacentBuildings; disabled
inspect_street_segment_6 = InspectStreetSegment(StreetSegmentCurve=curve_10)  # -> Geometry, Metadata, AdjacentBuildings; disabled
list_length = ListLength(List=curve_12)  # disabled
inspect_street_segment_7 = InspectStreetSegment(StreetSegmentCurve=curve_13)  # -> Geometry, Metadata, AdjacentBuildings; disabled
list_length_2 = ListLength(List=curve_10)  # disabled
create_building_5 = CreateBuilding(BuildingCurve=graft(curve_9), Metadata=graft(create_metadata_7))
adp_trip_engine = ADPTripEngine(
    UrbanoModel=build_urbano_model.UrbanoModel,
    Building=build_urbano_model.BuildingCurves,
    ActivityDemandProfile=activity_demand_profile_persona_2,
    SingleTravelMode="pedestrian",
    DestinationChoiceModel="nearest",
    BuildToggle=False)  # disabled
text_2 = Text(create_street_network.UTMZone)
vector_2 = Vector(create_street_network.TranslationVector)
create_street_network_4 = CreateStreetNetwork(
    StreetCurves=flatten(polyline_4),
    Metadata=flatten(import_osm_features_9.Metadata),
    SplitStreetCurves=True,
    UTMZone=import_osm_features_9.UTMZone,
    TranslationVector=import_osm_features_9.TranslationVector)  # -> StreetNetwork, StreetSegmentCurves, UTMZone, TranslationVector
create_street_network_5 = CreateStreetNetwork(
    StreetCurves=flatten(merge_6),
    Metadata=flatten(merge_5),
    SplitStreetCurves=True,
    UTMZone=create_street_network_4.UTMZone,
    TranslationVector=create_street_network_4.TranslationVector)  # -> StreetNetwork, StreetSegmentCurves, UTMZone, TranslationVector; disabled
merge_7 = Merge(Data1=curve_15, Data2=flatten(create_building_3))  # disabled
duplicate_data = DuplicateData(Data=create_metadata_12, Number=list_length, Order=True)  # disabled
duplicate_data_2 = DuplicateData(Data=create_metadata_11, Number=list_length_2, Order=True)  # disabled
arrange_amenities_by_building_5 = ArrangeAmenitiesByBuilding(Amenities=flatten(create_amenity_4), Buildings=flatten(polyline_5))  # -> AmenitiesByBuilding, Buildings
create_building_6 = CreateBuilding(
    BuildingCurve=arrange_amenities_by_building_4.Buildings,
    AmenitiesInBuilding=arrange_amenities_by_building_4.AmenitiesByBuilding)  # disabled
inspect_building = InspectBuilding(Building=create_building_4)  # -> Geometry, Metadata, Amenity, BuildingMesh
inspect_building_2 = InspectBuilding(Building=create_building_5)  # -> Geometry, Metadata, Amenity, BuildingMesh
create_amenity_5 = CreateAmenity(PointLocationOfAmenity=import_osm_features_5.Points, Metadata=merge_metadata_6)
merge_metadata_8 = MergeMetadata(Metadata=inspect_street_segment_4.Metadata, Metadata_2=duplicate_data)  # disabled
merge_metadata_9 = MergeMetadata(Metadata=inspect_street_segment_6.Metadata, Metadata_2=duplicate_data_2)  # disabled
street_hits = StreetHits(UrbanoModel=build_urbano_model.UrbanoModel, Trips=flatten(adp_trip_engine))  # -> StreetCurves, StreetHits, Trips; disabled
build_urbano_model_2 = BuildUrbanoModel(Buildings=flatten(merge_7), StreetNetwork=cluster.street_network, BuildToggle=True)  # -> UrbanoModel, BuildingCurves, Activities; disabled
create_amenity_6 = CreateAmenity(PointLocationOfAmenity=import_osm_features.Points, Metadata=replace_items)
number_slider_6 = Slider(10, range=10..300)  # disabled
merge_8 = Merge(Data1=curve_15, Data2=flatten(create_building_6))  # disabled
create_building_7 = CreateBuilding(
    BuildingCurve=polyline_5,
    Metadata=import_osm_features_7.Metadata,
    AmenitiesInBuilding=arrange_amenities_by_building_5.AmenitiesByBuilding)
build_urbano_model_3 = BuildUrbanoModel(Buildings=flatten(create_building_7), StreetNetwork=create_street_network_5.StreetNetwork, BuildToggle=True)  # -> UrbanoModel, BuildingCurves, Activities; disabled
merge_9 = Merge(Data1=flatten(merge_metadata_8), Data2=flatten(inspect_street_segment_5.Metadata))  # disabled
merge_10 = Merge(Data1=inspect_street_segment_4.Geometry, Data2=inspect_street_segment_5.Geometry)  # disabled
merge_11 = Merge(Data1=flatten(merge_metadata_9), Data2=flatten(inspect_street_segment_7.Metadata))  # disabled
merge_12 = Merge(Data1=inspect_street_segment_6.Geometry, Data2=inspect_street_segment_7.Geometry)  # disabled
series = Series(Start=0, Step=1, Count=10)
activity_demand_profile_persona_3 = ActivityDemandProfilePersona(ColumnIndex=1, Normalize=False, Persona="restaurant,1")  # disabled
build_urbano_model_4 = BuildUrbanoModel(Buildings=flatten(merge_8), StreetNetwork=create_street_network.StreetNetwork, BuildToggle=True)  # -> UrbanoModel, BuildingCurves, Activities; disabled
arrange_amenities_by_building_6 = ArrangeAmenitiesByBuilding(Amenities=flatten(create_amenity_5), Buildings=flatten(polyline_6))  # -> AmenitiesByBuilding, Buildings
inspect_building_3 = InspectBuilding(Building=create_building_2)  # -> Geometry, Metadata, Amenity, BuildingMesh
build_urbano_model_5 = BuildUrbanoModel(Buildings=flatten(create_building_7), StreetNetwork=create_street_network_4.StreetNetwork, BuildToggle=True)  # -> UrbanoModel, BuildingCurves, Activities
# Step3. Site Analysis
urbano_model = UrbanoModel(build_urbano_model_5.UrbanoModel)  # disabled
# Example1: Visualize Travel Radius
building_curves = Curve(build_urbano_model_5.BuildingCurves)  # disabled
router = Router(
    RouterUrbanoModelOrStreetNetwork=urbano_model,
    Origin=point_3,
    Destination=building_curves,
    TravelMode=["pedestrian", "bike"],
    TimeLimit=-1)  # -> Trip, Route, Time, Distance; disabled
adp_trip_engine_2 = ADPTripEngine(
    UrbanoModel=urbano_model,
    Building=building_curves,
    ActivityDemandProfile=activity_demand_profile_persona,
    SingleTravelMode="bike",
    DestinationChoiceModel="nearest",
    BuildToggle=False)  # disabled
smaller_than = SmallerThan(FirstNumber=router.Time, SecondNumber=number_slider_4)  # -> SmallerThan, OrEqualTo; disabled
dispatch = Dispatch(List=router.Trip, DispatchPattern=smaller_than.SmallerThan)  # -> ListA, ListB; disabled
inspect_trip = InspectTrip(Trip=dispatch.ListA)  # -> Origin, Destination, Time, Distance, Route, Mode, People, Activity, Amenity; disabled
larger_than = LargerThan(FirstNumber=street_hits.StreetHits, SecondNumber=number_slider_6)  # -> LargerThan, OrEqualTo; disabled
arrange_amenities_by_building_7 = ArrangeAmenitiesByBuilding(Amenities=flatten(create_amenity_6), Buildings=flatten(polyline))  # -> AmenitiesByBuilding, Buildings
adp_trip_engine_3 = ADPTripEngine(
    UrbanoModel=build_urbano_model_2.UrbanoModel,
    Building=build_urbano_model_2.BuildingCurves,
    ActivityDemandProfile=activity_demand_profile_persona_2,
    SingleTravelMode="pedestrian",
    DestinationChoiceModel="nearest",
    BuildToggle=False)  # disabled
create_street_network_6 = CreateStreetNetwork(
    StreetCurves=flatten(merge_10),
    Metadata=flatten(merge_9),
    SplitStreetCurves=True,
    UTMZone=create_street_network.UTMZone,
    TranslationVector=create_street_network.TranslationVector)  # -> StreetNetwork, StreetSegmentCurves, UTMZone, TranslationVector; disabled
create_street_network_7 = CreateStreetNetwork(
    StreetCurves=flatten(merge_12),
    Metadata=flatten(merge_11),
    SplitStreetCurves=True,
    UTMZone=create_street_network.UTMZone,
    TranslationVector=create_street_network.TranslationVector)  # -> StreetNetwork, StreetSegmentCurves, UTMZone, TranslationVector; disabled
adp_trip_engine_4 = ADPTripEngine(
    UrbanoModel=build_urbano_model_3.UrbanoModel,
    Building=build_urbano_model_3.BuildingCurves,
    ActivityDemandProfile=activity_demand_profile_persona,
    SingleTravelMode="bike",
    DestinationChoiceModel="nearest",
    BuildToggle=False)  # disabled
inspect_building_4 = InspectBuilding(Building=create_building)  # -> Geometry, Metadata, Amenity, BuildingMesh
create_building_8 = CreateBuilding(
    BuildingCurve=arrange_amenities_by_building_6.Buildings,
    Metadata=import_osm_features_4.Metadata,
    AmenitiesInBuilding=arrange_amenities_by_building_6.AmenitiesByBuilding)
curve_18 = Curve(<curve referenced from the Rhino model>)  # disabled
create_building_9 = CreateBuilding(
    BuildingCurve=polyline,
    Metadata=import_osm_features_3.Metadata,
    AmenitiesInBuilding=arrange_amenities_by_building_7.AmenitiesByBuilding)
dispatch_2 = Dispatch(List=street_hits.StreetCurves, DispatchPattern=larger_than.OrEqualTo)  # -> ListA, ListB; disabled
merge_13 = Merge(Data1=flatten(create_building_8), Data2=flatten(create_building), Data3=flatten(create_building_2))
build_urbano_model_6 = BuildUrbanoModel(Buildings=flatten(merge_13), StreetNetwork=create_street_network.StreetNetwork, BuildToggle=True)  # -> UrbanoModel, BuildingCurves, Activities
# Example3: Evaluate Building-Level Walkscore
building_curves_2 = Curve(build_urbano_model_6.BuildingCurves)
urbano_model_2 = UrbanoModel(build_urbano_model_6.UrbanoModel)
walkscore_trip_engine = WalkScoreTripEngine(UrbanoModel=urbano_model_2, Building=building_curves_2)  # -> WalkScoreTrips, WalkScore; disabled
area_2 = Area(Geometry=building_curves_2)  # -> Area, Centroid
bounds = Bounds(Numbers=walkscore_trip_engine.WalkScore)
deconstruct_domain = DeconstructDomain(Domain=bounds)  # -> Start, End
street_hits_2 = StreetHits(UrbanoModel=urbano_model_2, Trips=flatten(walkscore_trip_engine.WalkScoreTrips))  # -> StreetCurves, StreetHits, Trips
gradient = Gradient(
    LowerLimit=deconstruct_domain.End,
    UpperLimit=deconstruct_domain.Start,
    Parameter=walkscore_trip_engine.WalkScore,
    stops=[0: RGB(234, 38, 0), 0.25: RGB(234, 126, 0), 0.5: RGB(254, 244, 84), 0.75: RGB(173, 203, 249), 1: RGB(75, 107, 169)])
inspect_building_5 = InspectBuilding(Building=building_curves_2)  # -> Geometry, Metadata, Amenity, BuildingMesh
inside = INSIDE(relay=build_urbano_model_4.BuildingCurves, C=curve_18)  # -> flatten(crv_2), B; disabled
panel_5 = Panel("3")  # disabled
street_hits_3 = StreetHits(UrbanoModel=build_urbano_model_2.UrbanoModel, Trips=flatten(adp_trip_engine_3))  # -> StreetCurves, StreetHits, Trips; disabled
custom_preview = CustomPreview(Geometry=inspect_building_5.BuildingMesh, Material=gradient)
activity_demand_profile_persona_4 = ActivityDemandProfilePersona(
    ColumnIndex=1,
    Normalize=False,
    Persona="""post_office,0.001237014
bank,0.017194476
cinema,0.038842195
theatre,0.020781812
arts_centre,0.012370127
pharmacy,0.114794771
restaurant,0.196437603
fast_food,0.02350324
cafe,0.082756143
bar,0.101682436
pub,0.101682436
department_store,0.018926293
supermarket_store,0.071004524
convenience_store,0.018184085
hardware_store,0.015338957
clothes_store,0.092528544
books_store,0.010267204
shoes_store,0.025729863
beauty_store,0.036739274""")
adp_trip_engine_5 = ADPTripEngine(
    UrbanoModel=build_urbano_model_4.UrbanoModel,
    Building=inside.crv_2,
    ActivityDemandProfile=activity_demand_profile_persona_3,
    SingleTravelMode="pedestrian",
    DestinationChoiceModel="by_destination_factor",
    DestinationFactorKeys="amenity_capacity",
    TimeLimit=panel_5,
    BuildToggle=False)  # disabled
build_urbano_model_7 = BuildUrbanoModel(Buildings=flatten(curve_15), StreetNetwork=create_street_network_6.StreetNetwork, BuildToggle=True)  # -> UrbanoModel, BuildingCurves, Activities; disabled
inspect_building_6 = InspectBuilding(Building=build_urbano_model_5.BuildingCurves)  # -> Geometry, Metadata, Amenity, BuildingMesh
build_urbano_model_8 = BuildUrbanoModel(Buildings=flatten(curve_15), StreetNetwork=create_street_network_7.StreetNetwork, BuildToggle=True)  # -> UrbanoModel, BuildingCurves, Activities; disabled
build_urbano_model_9 = BuildUrbanoModel(Buildings=flatten(create_building_9), StreetNetwork=create_street_network_2.StreetNetwork, BuildToggle=True)  # -> UrbanoModel, BuildingCurves, Activities
find_amenities = FindAmenities(UrbanoModel=build_urbano_model_5.UrbanoModel, Activity="restaurant")
number_slider_7 = Slider(10, range=0..10)
adp_trip_engine_6 = ADPTripEngine(
    UrbanoModel=build_urbano_model_6.UrbanoModel,
    Building=build_urbano_model_6.BuildingCurves,
    ActivityDemandProfile=activity_demand_profile_persona_4,
    SingleTravelMode="pedestrian",
    DestinationChoiceModel="by_destination_factor",
    DestinationFactorKeys="amenity_capacity",
    TimeLimit=number_slider_7,
    BuildToggle=False)
curve_19 = Curve(dispatch_2.ListA)  # disabled
street_hits_4 = StreetHits(UrbanoModel=build_urbano_model_6.UrbanoModel, Trips=flatten(adp_trip_engine_6))  # -> StreetCurves, StreetHits, Trips
building_hits = BuildingHits(Trips=flatten(adp_trip_engine_6))  # -> BuildingCurves, BuildingHits, BuildingTrips
build_urbano_model_10 = BuildUrbanoModel(Buildings=flatten(merge_13), StreetNetwork=create_street_network_3.StreetNetwork, BuildToggle=True)  # -> UrbanoModel, BuildingCurves, Activities
inspect_amenity = InspectAmenity(Amenity=find_amenities)  # -> Name, Activities, Host, Metadata
building_hits_2 = BuildingHits(Trips=flatten(adp_trip_engine_5))  # -> BuildingCurves, BuildingHits, BuildingTrips; disabled
adp_trip_engine_7 = ADPTripEngine(
    UrbanoModel=build_urbano_model_7.UrbanoModel,
    Building=build_urbano_model_7.BuildingCurves,
    ActivityDemandProfile=activity_demand_profile_persona_2,
    SingleTravelMode="pedestrian",
    DestinationChoiceModel="nearest",
    BuildToggle=False)  # disabled
number_slider_8 = Slider(24, range=0..200)  # disabled
adp_trip_engine_8 = ADPTripEngine(
    UrbanoModel=build_urbano_model_8.UrbanoModel,
    Building=build_urbano_model_8.BuildingCurves,
    ActivityDemandProfile=activity_demand_profile_persona_2,
    SingleTravelMode="pedestrian",
    DestinationChoiceModel="nearest",
    BuildToggle=False)  # disabled
adp_trip_engine_9 = ADPTripEngine(
    UrbanoModel=build_urbano_model_9.UrbanoModel,
    Building=build_urbano_model_9.BuildingCurves,
    ActivityDemandProfile=activity_demand_profile_persona,
    SingleTravelMode="bike",
    DestinationChoiceModel="by_destination_factor",
    DestinationFactorKeys="custom_destination_factor",
    TimeLimit=Slider(8, range=1..10),
    BuildToggle=False)
panel_6 = Panel("-1")  # disabled
inspect_building_7 = InspectBuilding(Building=build_urbano_model_8.BuildingCurves)  # -> Geometry, Metadata, Amenity, BuildingMesh; disabled
sort_list = SortList(Keys=building_hits_2.BuildingHits, ValuesValuesA=building_hits_2.BuildingCurves)  # -> Keys, ValuesValuesA; disabled
adp_trip_engine_10 = ADPTripEngine(
    UrbanoModel=build_urbano_model_10.UrbanoModel,
    Building=build_urbano_model_10.BuildingCurves,
    ActivityDemandProfile=activity_demand_profile_persona_4,
    SingleTravelMode="pedestrian",
    DestinationChoiceModel="by_destination_factor",
    DestinationFactorKeys="amenity_capacity",
    TimeLimit=number_slider_7,
    BuildToggle=False)
series_2 = Series(Start=panel_6, Step=panel_6, Count=number_slider_8)  # disabled
street_hits_5 = StreetHits(UrbanoModel=build_urbano_model_8.UrbanoModel, Trips=flatten(adp_trip_engine_8))  # -> StreetCurves, StreetHits, Trips; disabled
street_hits_6 = StreetHits(UrbanoModel=build_urbano_model_7.UrbanoModel, Trips=flatten(adp_trip_engine_7))  # -> StreetCurves, StreetHits, Trips; disabled
amenity_hits = AmenityHits(Trips=flatten(adp_trip_engine_9))  # -> Amenity, AmenityHits, AmenityHosts, Trips
list_item_3 = ListItem(List=sort_list.ValuesValuesA, Index=series_2, Wrap=True)  # disabled
street_hits_7 = StreetHits(UrbanoModel=build_urbano_model_10.UrbanoModel, Trips=flatten(adp_trip_engine_10))  # -> StreetCurves, StreetHits, Trips
curve_20 = Curve(list_item_3)  # disabled
trip_amenityscore = TripAmenityscore(Trips=flatten(adp_trip_engine_10))  # -> Amenityscore, Amenity, AmenityHosts
building_hits_3 = BuildingHits(Trips=flatten(adp_trip_engine_10))  # -> BuildingCurves, BuildingHits, BuildingTrips
inspect_amenity_2 = InspectAmenity(Amenity=amenity_hits.Amenity)  # -> Name, Activities, Host, Metadata
match_text = MatchText(Text=inspect_amenity_2.Activities, Pattern="restaurant", Case=True)  # -> flatten(Match)
panel_7 = Panel(trip_amenityscore.Amenity)
dispatch_3 = Dispatch(List=inspect_amenity_2.Host, DispatchPattern=match_text)  # -> ListA, ListB
dispatch_4 = Dispatch(List=amenity_hits.AmenityHits, DispatchPattern=match_text)  # -> ListA, ListB
unit_z = UnitZ(Factor=dispatch_4.ListA)
panel_8 = Panel(trip_amenityscore.Amenityscore)
street_hits_8 = StreetHits(UrbanoModel=build_urbano_model_9.UrbanoModel, Trips=flatten(adp_trip_engine_9))  # -> StreetCurves, StreetHits, Trips
extrude = Extrude(Base=dispatch_3.ListA, Direction=unit_z)

# ==== cluster Cluster_3
bound = ClusterInput()
osm_path_or_url = ClusterInput()
bound_2 = Curve(bound)
osm_path_or_url_2 = ClusterInput()
osm_path_or_url_3 = ClusterInput()
import_osm_features = ImportOSMFeatures(OSMPathOrURL=osm_path_or_url_2, OSMFeatureType="building", Format="xml")  # -> Points, Metadata, UTMZone, TranslationVector
import_osm_features_2 = ImportOSMFeatures(OSMPathOrURL=osm_path_or_url_3, OSMFeatureType="amenity", Format="xml")  # -> flatten(Points), flatten(Metadata), UTMZone, TranslationVector
import_osm_features_3 = ImportOSMFeatures(OSMPathOrURL=osm_path_or_url, OSMFeatureType="street", Format="xml")  # -> Points, Metadata, UTMZone, TranslationVector
polyline = PolyLine(Vertices=import_osm_features_3.Points, Closed=False)

lookup_metadata = LookupMetadata(MetadataGeometry=import_osm_features_2.Metadata, SearchKey="amenity")
amenity_capacity = AmenityCapacity(
    Activity=lookup_metadata,
    Area=-1,
    LogisticsAreaProportion=0.2,
    AmenityCapacityData="""post_office, 5, 15
bank, 5, 15
cinema, 1, 248
theatre, 1, 215
arts_centre, 3, 20
department_store, 1, 78
supermarket_store, 2, 32
convenience_store, 1, 39
hardware_store, 1, 50
pharmacy, 1, 42
restaurant, 2, 35
fast_food, 1, 36
cafe, 1, 50
bar, 1, 47
pub, 1, 47
clothes_store, 2, 21
books_store, 1, 26
beauty_store, 1, 27
shoes_store, 1, 38""")
merge_metadata = MergeMetadata(Metadata=import_osm_features_2.Metadata, Metadata_2=amenity_capacity)

polyline_2 = PolyLine(Vertices=import_osm_features.Points, Closed=False)
create_street_network = CreateStreetNetwork(
    StreetCurves=flatten(polyline),
    Metadata=flatten(import_osm_features_3.Metadata),
    SplitStreetCurves=True,
    UTMZone=import_osm_features_3.UTMZone,
    TranslationVector=import_osm_features_3.TranslationVector)  # -> StreetNetwork, StreetSegmentCurves, UTMZone, TranslationVector
street_curves = Curve(create_street_network.StreetSegmentCurves)
create_amenity = CreateAmenity(PointLocationOfAmenity=import_osm_features_2.Points, Metadata=merge_metadata)
pln = Plane(PlaneXY(296, 273, 0))
arrange_amenities_by_building = ArrangeAmenitiesByBuilding(Amenities=flatten(create_amenity), Buildings=flatten(polyline_2))  # -> AmenitiesByBuilding, Buildings
sqgrid = Square(Plane=pln, Size=Slider(12, range=0..100), ExtentX=Slider(34, range=10..40), ExtentY=Slider(39, range=0..50))  # -> Cells, Points
crv = Curve(simplify(sqgrid.Cells))
crv_2 = Curve(sqgrid.Cells)
explode = Explode(Curve=crv, Recursive=True)  # -> Segments, Vertices
create_building = CreateBuilding(
    BuildingCurve=arrange_amenities_by_building.Buildings,
    Metadata=import_osm_features.Metadata,
    AmenitiesInBuilding=arrange_amenities_by_building.AmenitiesByBuilding)
flip = FlipMatrix(Data=sqgrid.Points)
offset = OffsetCurve(Curve=crv_2, Distance=Slider(-5, range=-5..0), Plane=PlaneXY(0, 0, 0), Corners=1)
item = ListItem(List=explode.Vertices, Index=0, Wrap=True)  # -> Item, Item1, Item2, Item3
pline = PolyLine(Vertices=sqgrid.Points, Closed=False)
ln = Line(StartPoint=item.Item1, EndPoint=item.Item3)
pline_2 = PolyLine(Vertices=flip, Closed=False)
ln_2 = Line(StartPoint=item.Item, EndPoint=item.Item2)
merge = Merge(Data1=flatten(pline), Data2=flatten(pline_2), Data3=flatten(ln_2), Data4=flatten(ln))

cluster = Cluster(relay=merge, relay_2=bound_2)
cluster_2 = Cluster_2(relay=street_curves, relay_2=bound_2)

merge_2 = Merge(Data1=cluster_2, Data2=cluster, Data3=bound_2)
inspect_street_segment = InspectStreetSegment(StreetSegmentCurve=merge_2)  # -> Geometry, Metadata, AdjacentBuildings
create_street_network_2 = CreateStreetNetwork(
    StreetCurves=flatten(inspect_street_segment.Geometry),
    Metadata=flatten(inspect_street_segment.Metadata),
    SplitStreetCurves=True,
    UTMZone=create_street_network.UTMZone,
    TranslationVector=create_street_network.TranslationVector)  # -> StreetNetwork, StreetSegmentCurves, UTMZone, TranslationVector
inside = INSIDE(relay=offset, C=bound_2)  # -> flatten(crv_2), B
outside = OUTSIDE(relay=create_building, C=bound_2)  # -> flatten(crv_2), A
coordinate = Curve(inside.crv_2)
crv_3 = ClusterOutput(outside.crv_2)
street_network = ClusterOutput(create_street_network_2.StreetNetwork)
street_segment_curves = ClusterOutput(create_street_network_2.StreetSegmentCurves)
coordinate_2 = ClusterOutput(coordinate)

# ==== cluster Cluster
relay = ClusterInput()
relay_2 = ClusterInput()
ccx = CurveCurve(CurveA=relay, CurveB=relay_2)  # -> Points, ParamsA, ParamsB
lng = ListLength(List=ccx.ParamsA)
equals = Equality(FirstNumber=lng, SecondNumber=0)  # -> Equality, Inequality
shatter = Shatter(Curve=graft(relay), Parameters=ccx.ParamsA)
dispatch = Dispatch(List=graft(relay), DispatchPattern=equals.Equality)  # -> ListA, ListB
crv = Curve(dispatch.ListA)
merge = Merge(Data1=shatter, Data2=dispatch.ListA)  # -> flatten(Result)
midpt = CurveMiddle(Curve=merge)
incurve = PointInCurve(Point=midpt, Curve=relay_2)  # -> Relationship, Point
dispatch_2 = Dispatch(List=merge, DispatchPattern=incurve.Relationship)  # -> ListA, ListB
A = ClusterOutput(dispatch_2.ListA)

# ==== cluster Cluster_2
relay = ClusterInput()
relay_2 = ClusterInput()
ccx = CurveCurve(CurveA=relay, CurveB=relay_2)  # -> Points, ParamsA, ParamsB
lng = ListLength(List=ccx.ParamsA)
equals = Equality(FirstNumber=lng, SecondNumber=0)  # -> Equality, Inequality
shatter = Shatter(Curve=graft(relay), Parameters=ccx.ParamsA)
dispatch = Dispatch(List=graft(relay), DispatchPattern=equals.Equality)  # -> ListA, ListB
crv = Curve(dispatch.ListA)
merge = Merge(Data1=shatter, Data2=dispatch.ListA)  # -> flatten(Result)
midpt = CurveMiddle(Curve=merge)
incurve = PointInCurve(Point=midpt, Curve=relay_2)  # -> Relationship, Point
dispatch_2 = Dispatch(List=merge, DispatchPattern=incurve.Relationship)  # -> ListA, ListB
B = ClusterOutput(dispatch_2.ListB)

# ==== cluster INSIDE
relay = ClusterInput()
area = Area(Geometry=relay)  # -> Area, Centroid
C = ClusterInput()
incurve = PointInCurve(Point=area.Centroid, Curve=C)  # -> Relationship, Point
equals = Equality(FirstNumber=incurve.Relationship, SecondNumber=0)  # -> Equality, Inequality
L = ClusterInput()
dispatch = Dispatch(List=L, DispatchPattern=equals.Equality)  # -> ListA, ListB
dispatch_2 = Dispatch(List=relay, DispatchPattern=equals.Equality)  # -> ListA, ListB
B = ClusterOutput(dispatch.ListB)
crv = Curve(dispatch_2.ListB)
crv_2 = ClusterOutput(crv)

# ==== cluster OUTSIDE
relay = ClusterInput()
area = Area(Geometry=relay)  # -> Area, Centroid
C = ClusterInput()
incurve = PointInCurve(Point=area.Centroid, Curve=C)  # -> Relationship, Point
equals = Equality(FirstNumber=incurve.Relationship, SecondNumber=0)  # -> Equality, Inequality
L = ClusterInput()
dispatch = Dispatch(List=L, DispatchPattern=equals.Equality)  # -> ListA, ListB
dispatch_2 = Dispatch(List=relay, DispatchPattern=equals.Equality)  # -> ListA, ListB
A = ClusterOutput(dispatch.ListA)
crv = Curve(dispatch_2.ListA)
crv_2 = ClusterOutput(crv)
